# Dynamo graph 1_AssignLayer.dyn (Dynamo 2.10.1.3976)

# group: READ ME
# note: TBC...

# group: Get elements from groups
categories = Categories("OST_IOSModelGroups")  # frozen
all_elements_of_category = ElementsOfCategory(Category=categories)
getMembers = Group.GetMembers(group=all_elements_of_category)
flatten = List.Flatten(list=getMembers)
uniqueItems = List.UniqueItems(list=flatten)

# group: Collect all elements
code_block = CodeBlock { "Floors"; "Structural Columns"; "Structural Framing"; "Structural Foundations"; }
byName = Category.ByName(name=code_block.out3)
all_elements_of_category_2 = ElementsOfCategory(Category=byName)
code_block_2 = CodeBlock { "Walls"; }
byName_2 = Category.ByName(name=code_block_2)
all_elements_of_category_3 = ElementsOfCategory(Category=byName_2)
byName_3 = Category.ByName(name=code_block.out1)
all_elements_of_category_4 = ElementsOfCategory(Category=byName_3)
byName_4 = Category.ByName(name=code_block.out2)
all_elements_of_category_5 = ElementsOfCategory(Category=byName_4)
byName_5 = Category.ByName(name=code_block.out0)
all_elements_of_category_6 = ElementsOfCategory(Category=byName_5)
code_block_3 = CodeBlock { "Roofs"; "Windows"; }
byName_6 = Category.ByName(name=code_block_3.out0)
all_elements_of_category_7 = ElementsOfCategory(Category=byName_6)
byName_7 = Category.ByName(name=code_block_3.out1)
all_elements_of_category_8 = ElementsOfCategory(Category=byName_7)
code_block_4 = CodeBlock { "Doors"; }
byName_8 = Category.ByName(name=code_block_4)
all_elements_of_category_9 = ElementsOfCategory(Category=byName_8)
code_block_5 = CodeBlock { "Ceilings"; "Columns"; }
byName_9 = Category.ByName(name=code_block_5.out0)
all_elements_of_category_10 = ElementsOfCategory(Category=byName_9)
byName_10 = Category.ByName(name=code_block_5.out1)
all_elements_of_category_11 = ElementsOfCategory(Category=byName_10)

# group: Dispatch structural walls
code_block_6 = CodeBlock { "Structural"; 1; }
getParameterValueByName = Element.GetParameterValueByName(element=all_elements_of_category_3, parameterName=code_block_6.out0)
eq = getParameterValueByName == code_block_6.out1
filterByBoolMask = List.FilterByBoolMask(list=all_elements_of_category_3, mask=eq)

code_block_7 = CodeBlock(foundations=all_elements_of_category_2, str_walls=filterByBoolMask.in, str_columns=all_elements_of_category_4, str_framing=all_elements_of_category_5, slabs=all_elements_of_category_6)
# ---------- code_block_7.designscript (7 lines) ----------
Structure = [
	foundations,
	str_walls,
	str_columns,
	str_framing,
	slabs
];
# ----------------------------------------

# group: Dispatch external walls
code_block_8 = CodeBlock { "Is internal"; true; }
getParameterValueByName_2 = Element.GetParameterValueByName(element=filterByBoolMask.out, parameterName=code_block_8.out0)
eq_2 = getParameterValueByName_2 == code_block_8.out1
code_block_9 = CodeBlock { ""; }
eq_3 = getParameterValueByName_2 == code_block_9
or_ = eq_2 || eq_3
filterByBoolMask_2 = List.FilterByBoolMask(list=filterByBoolMask.out, mask=or_)

# group: Dispatch doors ext/int
code_block_10 = CodeBlock(doors=all_elements_of_category_9) { doors; }
code_block_11 = CodeBlock { "Host Id"; }
getParameterValueByName_3 = Element.GetParameterValueByName(element=code_block_10, parameterName=code_block_11)
code_block_12 = CodeBlock { "-1"; }
eq_4 = getParameterValueByName_3 == code_block_12
filterByBoolMask_3 = List.FilterByBoolMask(list=getParameterValueByName_3, mask=eq_4)
code_block_13 = CodeBlock { "Is internal"; true; }
getParameterValueByName_4 = Element.GetParameterValueByName(element=filterByBoolMask_3.out, parameterName=code_block_13.out0)
eq_5 = getParameterValueByName_4 == code_block_13.out1
code_block_14 = CodeBlock { ""; }
eq_6 = getParameterValueByName_4 == code_block_14
or_2 = eq_5 || eq_6
code_block_15 = CodeBlock { true; }
allIndicesOf = List.AllIndicesOf(list=eq_4, item=code_block_15)
python_script = Python(IN[0]=or_2, IN[1]=allIndicesOf)  # IronPython2
# ---------- python_script.python (6 lines) ----------
result = IN[0]

for i in range(len(IN[1])):
	result.insert(IN[1][i], True)
	
OUT = result
# ----------------------------------------
filterByBoolMask_4 = List.FilterByBoolMask(list=code_block_10, mask=python_script)

code_block_16 = CodeBlock(roof=all_elements_of_category_7, nstr_ext_walls=filterByBoolMask_2.out, windows=all_elements_of_category_8, ext_doors=filterByBoolMask_4.out)
# ---------- code_block_16.designscript (6 lines) ----------
Skin = [
	roof,
	nstr_ext_walls,
	windows,
	ext_doors
];
# ----------------------------------------
code_block_17 = CodeBlock(int_doors=filterByBoolMask_4.in, nstr_int_walls=filterByBoolMask_2.in, ceilings=all_elements_of_category_10, columns=all_elements_of_category_11)
# ---------- code_block_17.designscript (6 lines) ----------
SpacePlan = [
	int_doors,
	nstr_int_walls,
	ceilings,
	columns
];
# ----------------------------------------

# group: Write the information in parameters
code_block_18 = CodeBlock(Structure=code_block_7, Skin=code_block_16, SpacePlan=code_block_17) { Site; Structure; Skin; Services; SpacePlan; Stuff; }  # unwired: Site, Services, Stuff
code_block_19 = CodeBlock { "Building layer"; }
code_block_20 = CodeBlock { Site = 0; Structure = 1; Skin = 2; Services = 3; SpacePlan = 4; Stuff = 5; }
setParameterByName = Element.SetParameterByName(element=code_block_18.Structure, parameterName=code_block_19, value=code_block_20.Structure)
setParameterByName_2 = Element.SetParameterByName(element=code_block_18.Skin, parameterName=code_block_19, value=code_block_20.Skin)
setParameterByName_3 = Element.SetParameterByName(element=code_block_18.SpacePlan, parameterName=code_block_19, value=code_block_20.SpacePlan)

# group: Color in view
list_create = List.Create(item0=setParameterByName, item1=setParameterByName_2, item2=setParameterByName_3)
flatten_2 = List.Flatten(list=list_create)
code_block_21 = CodeBlock()
# ---------- code_block_21.designscript (5 lines) ----------
//Color.ByARGB(255, 0, 189, 124)
//Color.ByARGB(255, 255, 237, 0)
Color.ByARGB(255, 102, 204, 204);
Color.ByARGB(255, 68, 68, 68);
Color.ByARGB(255, 236, 26, 146);
# ----------------------------------------
flatten_3 = List.Flatten(list=setParameterByName)
count = List.Count(list=flatten_3)
ofRepeatedItem = List.OfRepeatedItem(item=code_block_21.out1, amount=count)
flatten_4 = List.Flatten(list=setParameterByName_2)
count_2 = List.Count(list=flatten_4)
ofRepeatedItem_2 = List.OfRepeatedItem(item=code_block_21.out2, amount=count_2)
flatten_5 = List.Flatten(list=setParameterByName_3)
count_3 = List.Count(list=flatten_5)
ofRepeatedItem_3 = List.OfRepeatedItem(item=code_block_21.out0, amount=count_3)
join = List.Join(list0=ofRepeatedItem, list1=ofRepeatedItem_2, list2=ofRepeatedItem_3)
flatten_6 = List.Flatten(list=join)
code_block_22 = CodeBlock(c=flatten_6) { Color.Red(c)-50; Color.Green(c)-26; Color.Blue(c)-50; }
byARGB = Color.ByARGB(r=code_block_22.out0, g=code_block_22.out1, b=code_block_22.out2)
code_block_23 = CodeBlock { "<Solid fill>"; }
getByName = FillPatternElement.GetByName(name=code_block_23)
byProperties = Revit.Filter.OverrideGraphicSettings.ByProperties(projectionFillColor=join, projectionLineColor=byARGB, projectionFillPattern=getByName)

# group: Take all other elements from the view
id = Element.Id(element=flatten_2)
all_elements_in_active_view = ElementsInView()
id_2 = Element.Id(element=all_elements_in_active_view)
python_script_2 = Python(IN[0]=id, IN[1]=id_2)  # IronPython2
# ---------- python_script_2.python (13 lines) ----------
# Load the Python Standard and DesignScript Libraries
import sys
import clr
clr.AddReference('ProtoGeometry')
from Autodesk.DesignScript.Geometry import *

list_A = IN[0]
list_B = IN[1]

common = set(list_B).intersection(list_A)
difference = set(list_B) - set(list_A)

OUT = [common, difference]
# ----------------------------------------
code_block_24 = CodeBlock(seq=python_script_2) { common = seq[0]; difference = seq[1]; }
watch = Watch(code_block_24.common)
watch_2 = Watch(code_block_24.difference)
element_by_id = ElementById(Id=watch_2)

# group: Veify if color is needed
code_block_25 = CodeBlock(elements=flatten_2) { elements; }
color_elements_after_assigning = BoolSelector(true)  # "Color elements after assigning layer"; graph input
count_4 = List.Count(list=code_block_25)
ofRepeatedItem_4 = List.OfRepeatedItem(item=color_elements_after_assigning, amount=count_4)
filterByBoolMask_5 = List.FilterByBoolMask(list=code_block_25, mask=ofRepeatedItem_4)

# group (continued): Color in view
overrideInView = Element.OverrideInView(element=filterByBoolMask_5.in, overrides=byProperties)

# group: Veify if color is needed
count_5 = List.Count(list=element_by_id)
ofRepeatedItem_5 = List.OfRepeatedItem(item=color_elements_after_assigning, amount=count_5)
filterByBoolMask_6 = List.FilterByBoolMask(list=element_by_id, mask=ofRepeatedItem_5)

# group: Color all unwanted elements gray and transparent.
code_block_26 = CodeBlock(elements=filterByBoolMask_6.in) { elements; }
code_block_27 = CodeBlock { 100; }
byARGB_2 = Color.ByARGB(r=code_block_27, g=code_block_27, b=code_block_27)
code_block_28 = CodeBlock { 150; }
byARGB_3 = Color.ByARGB(r=code_block_28, g=code_block_28, b=code_block_28)
code_block_29 = CodeBlock { 80; }
byProperties_2 = Revit.Filter.OverrideGraphicSettings.ByProperties(projectionFillColor=byARGB_2, projectionLineColor=byARGB_3, projectionFillPattern=getByName, transparency=code_block_29)
overrideInView_2 = Element.OverrideInView(element=code_block_26, overrides=byProperties_2)

watch_3 = Watch(code_block_7)
