# Dynamo graph 1_MeasureCircularity.dyn "Revit_to_Excel" (Dynamo 2.12.0.5650)

# group: READ ME
# note: TBC...

# group: Collect all elements
code_block = CodeBlock()
# ---------- code_block.designscript (11 lines) ----------
[
"Doors",
"Windows",
"Floors",
"Structural Columns",
"Structural Framing",
"Walls",
"Ceilings",
"Columns",
"Structural Foundations"
];
# ----------------------------------------
include_the_foundations = BoolSelector(false)  # graph input
code_block_2 = CodeBlock { 8; -1; }
if_ = RefactoredIf(test=include_the_foundations, true=code_block_2.out0, false=code_block_2.out1)
removeItemAtIndex = List.RemoveItemAtIndex(list=code_block, indices=if_)
byName = Category.ByName(name=removeItemAtIndex)
all_elements_of_category = ElementsOfCategory(Category=byName)
flatten = List.Flatten(list=all_elements_of_category)

# group: Collect materials
code_block_3 = CodeBlock { "Revit material"; }
getMaterials = Element.GetMaterials(element=flatten)
name = Material.Name(material=getMaterials)
string_from_array = FromArray()  # unwired: arr
map = List.Map(list=name, f_x=string_from_array)
code_block_4 = CodeBlock(str=map) { x1 = String.Replace(str,"[",""); x2 = String.Replace(x1,"]",""); x3 = String.Replace(x2,",",", "); }
code_block_5 = CodeBlock(materials=code_block_4.x3) { materials; }

# group: Collect parameters
code_block_6 = CodeBlock()
# ---------- code_block_6.designscript (4 lines) ----------
[
"Id",
"Category"
];
# ----------------------------------------
code_block_7 = CodeBlock()
# ---------- code_block_7.designscript (6 lines) ----------
[
"Area",
"Volume"
];
//"Length",
//"Thickness",
# ----------------------------------------
code_block_8 = CodeBlock()
# ---------- code_block_8.designscript (3 lines) ----------
[
"Type Name"
];
# ----------------------------------------
join = List.Join(list0=code_block_6, list1=code_block_7, list2=code_block_8)  # frozen
code_block_9 = CodeBlock(elem=flatten) { elem; }
id = Element.Id(element=code_block_9)
getCategory = Element.GetCategory(element=code_block_9)
string_from_object = FromObject(obj=getCategory)
list_create = List.Create(item0=id, item1=string_from_object)
getParameterValueByName = Element.GetParameterValueByName(element=code_block_9, parameterName=code_block_7, lacing=CrossProduct)
transpose = List.Transpose(lists=getParameterValueByName)
code_block_10 = CodeBlock { "Type"; }
getParameterValueByName_2 = Element.GetParameterValueByName(element=code_block_9, parameterName=code_block_10, lacing=Longest)
getParameterValueByName_3 = Element.GetParameterValueByName(element=getParameterValueByName_2, parameterName=code_block_8, lacing=CrossProduct)
transpose_2 = List.Transpose(lists=getParameterValueByName_3)
join_2 = List.Join(list0=list_create, list1=transpose, list2=transpose_2)

# group: Combine and add headers
addItemToEnd = List.AddItemToEnd(item=code_block_3, list=join)
addItemToEnd_2 = List.AddItemToEnd(item=code_block_5, list=join_2)
transpose_3 = List.Transpose(lists=addItemToEnd_2)
addItemToFront = List.AddItemToFront(item=addItemToEnd, list=transpose_3)

# group: Check geometrical volume
code_block_11 = CodeBlock { elem; }  # frozen; unwired: elem
code_block_12 = CodeBlock { "Volume"; }
getParameterValueByName_4 = Element.GetParameterValueByName(element=code_block_11, parameterName=code_block_12)
sum = Math.Sum(values=getParameterValueByName_4)
sum_2 = Math.Sum(values=sum)
watch = Watch(sum_2)
geometry = Element.Geometry(element=code_block_11)  # frozen
flatten_2 = List.Flatten(list=geometry)
volume = Solid.Volume(solid=flatten_2)
sum_3 = Math.Sum(values=volume)
code_block_13 = CodeBlock(x=sum_3) { x/1000000000; }
watch_2 = Watch(code_block_13)

# group: Get elements from groups
categories = Categories("OST_IOSModelGroups")  # frozen
all_elements_of_category_2 = ElementsOfCategory(Category=categories)
getMembers = Group.GetMembers(group=all_elements_of_category_2)
flatten_3 = List.Flatten(list=getMembers)
uniqueItems = List.UniqueItems(list=flatten_3)

excel_template_file_location = StringInput(".\Template_Excel_report.xlsx")
file_from_path = FileObject(path=excel_template_file_location)
excel_report_directory_path = Directory("G:\My Drive\Projekty\2022 Circular EcoBIM\Dynamo tool\Tests")  # graph input
string = StringInput("\")
excel_report_file_name = StringInput("Test")  # graph input
string_2 = StringInput(".xlsx")
concat = String.Concat(string0=excel_report_directory_path, string1=string, string2=excel_report_file_name, string3=string_2)
boolean = BoolSelector(true)
copyFile = FileSystem.CopyFile(file=file_from_path, destinationPath=concat, overwrite=boolean)  # frozen
if_2 = RefactoredIf(test=copyFile, true=concat, false=concat)

# group: Export to Excel
string_3 = StringInput("Revit_data")
code_block_14 = CodeBlock { 1; 0; }
code_block_15 = CodeBlock(data=transpose_3) { data; }
boolean_2 = BoolSelector(false)
exportToExcel = Data.ExportToExcel(filePath=if_2, sheetName=string_3, startRow=code_block_14.out0, startColumn=code_block_14.out1, data=code_block_15, overWrite=boolean_2)

# group: Info display
isEmpty = List.IsEmpty(list=exportToExcel)
code_block_16 = CodeBlock(path=if_2) { "You're data was succesfully exported to Excel: "+path; "There was a problem exporting your Excel data."; }
if_3 = RefactoredIf(test=isEmpty, true=code_block_16.out1, false=code_block_16.out0)
export_result = Watch(if_3)  # graph output

returnPaintMaterials = BoolSelector(false)

# group: Circularity calculations
code_block_17 = CodeBlock { 3; }
random = Math.Random(seed=code_block_17)
string_from_object_2 = FromObject(object=random)
code_block_18 = CodeBlock { 0; 4; }
substring = String.Substring(string=string_from_object_2, startIndex=code_block_18.out0, length=code_block_18.out1)
code_block_19 = CodeBlock(x=substring) { "Your Circularity Index is: "+x+"."; }
circularity_indicator_score = Watch(code_block_19)  # graph output

# group: Take internal unit of measure ID
unit_types = UnitTypes("Area")
py_revit_version = Python()  # IronPython2
# ---------- py_revit_version.python (12 lines) ----------
import clr
clr.AddReference("RevitServices")
import RevitServices
from RevitServices.Persistence import DocumentManager

doc = DocumentManager.Instance.CurrentDBDocument
uiapp = DocumentManager.Instance.CurrentUIApplication
app = uiapp.Application
if int(app.VersionNumber) > 2017: fullVersion = app.SubVersionNumber
else: fullVersion = str(app.VersionNumber)

OUT = app.VersionName, int(app.VersionNumber), app.VersionBuild, app.Language.ToString(), fullVersion
# ----------------------------------------
code_block_20 = CodeBlock(seq=py_revit_version) { version = seq[1]; }
python_script = Python(IN[0]=unit_types, IN[1]=code_block_20)  # IronPython2
# ---------- python_script.python (43 lines) ----------
import clr
clr.AddReference('RevitAPI')
from Autodesk.Revit.DB import *

clr.AddReference("RevitServices")
import RevitServices
from RevitServices.Persistence import DocumentManager
doc = DocumentManager.Instance.CurrentDBDocument

dynunittype = IN[0]
if IN[1] > 2021:
	if str(dynunittype.GetType()) == "Autodesk.Revit.DB.ForgeTypeId":
		unittype = dynunittype
	elif str(dynunittype) == 'DynamoUnits.Area':
		unittype = ForgeTypeId('autodesk.spec.aec:area-2.0.0')
	elif str(dynunittype) == 'DynamoUnits.Length':
		unittype = ForgeTypeId('autodesk.spec.aec:length-2.0.0')
	elif str(dynunittype) == 'DynamoUnits.Volume':
		unittype = ForgeTypeId('autodesk.spec.aec:volume-2.0.0')
	else:
		unittype = None
	formatoptions = doc.GetUnits().GetFormatOptions(unittype)
	dispunits = formatoptions.GetUnitTypeId()
	symtype = formatoptions.GetSymbolTypeId()
	if symtype.TypeId == '': dispsym = None
	else: dispsym = LabelUtils.GetLabelForSymbol(symtype)
else:
	if str(dynunittype.GetType()) == "Autodesk.Revit.DB.UnitType":
		unittype = dynunittype
	elif str(dynunittype) == 'DynamoUnits.Area':
		unittype = UnitType.UT_Area
	elif str(dynunittype) == 'DynamoUnits.Length':
		unittype = UnitType.UT_Length
	elif str(dynunittype) == 'DynamoUnits.Volume':
		unittype = UnitType.UT_Volume
	else:
		unittype = None
	formatoptions = doc.GetUnits().GetFormatOptions(unittype)
	dispunits = formatoptions.DisplayUnits
	symtype = formatoptions.UnitSymbol
	if symtype == UnitSymbolType.UST_NONE: dispsym = None
	else: dispsym = LabelUtils.GetLabelFor(symtype)
OUT = (dispunits,dispsym)
# ----------------------------------------
code_block_21 = CodeBlock(seq=python_script) { displayUnitType = seq[0]; unitSymbol = seq[1]; }
unit_types_2 = UnitTypes("Volume")
python_script_2 = Python(IN[0]=unit_types_2, IN[1]=code_block_20)  # IronPython2; same code as python_script
code_block_22 = CodeBlock(seq=python_script_2) { displayUnitType = seq[0]; unitSymbol = seq[1]; }

# group: Collect info about materials (layers)
code_block_23 = CodeBlock(elem=flatten) { elem; }
turn_into_list = CodeBlock(x=code_block_23) { List.Flatten([x]); }
py_material_clockwork = Python(IN[0]=turn_into_list, IN[1]=returnPaintMaterials)  # IronPython2
# ---------- py_material_clockwork.python (22 lines) ----------
import clr
clr.AddReference('RevitAPI')
from Autodesk.Revit.DB import *

items = UnwrapElement(IN[0])
paintedmats = IN[1]
elementmats = list()
elementareas = list()
elementvols = list()

for item in items:
	matlist = list()
	arealist = list()
	vollist = list()
	for matid in item.GetMaterialIds(paintedmats):
		matlist.append(item.Document.GetElement(matid))
		arealist.append(item.GetMaterialArea(matid,paintedmats))
		vollist.append(item.GetMaterialVolume(matid))
	elementmats.append(matlist)
	elementareas.append(arealist)
	elementvols.append(vollist)
OUT = (elementmats,elementareas,elementvols)
# ----------------------------------------
code_block_24 = CodeBlock(seq=py_material_clockwork) { seq[0]; seq[1]; seq[2]; }
isEmpty_2 = List.IsEmpty()  # unwired: list
map_2 = List.Map(list=code_block_24.out0, function=isEmpty_2)
not_ = Not(x=map_2)
py_returnlistorsinglevalue = Python(IN[0]=code_block_23, IN[1]=not_)  # IronPython2
# ---------- py_returnlistorsinglevalue.python (4 lines) ----------
check = IN[0]
items = IN[1]
if isinstance(check, (list)): OUT = items
else: OUT = items[0]
# ----------------------------------------
code_block_25 = CodeBlock(hasMaterial=py_returnlistorsinglevalue) { hasMaterial; }
code_block_26 = CodeBlock(value=code_block_24.out1, displayUnitType=code_block_21.displayUnitType, RevitVersion=code_block_20) { value; displayUnitType; RevitVersion; }
py_internalunit_todisplayunit = Python(IN[0]=code_block_26.value, IN[1]=code_block_26.displayUnitType, IN[2]=code_block_26.RevitVersion)  # "Py InternalUnit.ToDisplayUnit (Clockwork)"; IronPython2
# ---------- py_internalunit_todisplayunit.python (26 lines) ----------
import clr
clr.AddReference('RevitAPI')
from Autodesk.Revit.DB import *

def FromInternalUnits(val, unittype):
	if (version > 2021 and str(dispunit.GetType()) == "Autodesk.Revit.DB.ForgeTypeId") or (version < 2022 and str(dispunit.GetType()) == "Autodesk.Revit.DB.DisplayUnitType"):
		return UnitUtils.ConvertFromInternalUnits(val,unittype)
	else: return None

vals = IN[0]
dispunit = IN[1]
version = IN[2]

# turn into list of lists:
if not isinstance(vals[0], list):
    vals = [vals]
if not isinstance(vals[0], list):
    vals = [vals]

OUT = []

for list in vals:
	inner = []
	for x in list:
		inner.append(FromInternalUnits(x, dispunit))
	OUT.append(inner)
# ----------------------------------------
py_returnlistorsinglevalue_2 = Python(IN[0]=code_block_23, IN[1]=py_internalunit_todisplayunit)  # IronPython2; same code as py_returnlistorsinglevalue
code_block_27 = CodeBlock(materialAreas=py_returnlistorsinglevalue_2) { materialAreas; }
py_returnlistorsinglevalue_3 = Python(IN[0]=code_block_23, IN[1]=code_block_24.out0)  # IronPython2; same code as py_returnlistorsinglevalue
code_block_28 = CodeBlock(materials=py_returnlistorsinglevalue_3) { materials; }
name_2 = Material.Name(material=code_block_28)
code_block_29 = CodeBlock(value=code_block_24.out2, displayUnitType=code_block_22.displayUnitType, RevitVersion=code_block_20) { value; displayUnitType; RevitVersion; }
py_internalunit_todisplayunit_2 = Python(IN[0]=code_block_29.value, IN[1]=code_block_29.displayUnitType, IN[2]=code_block_29.RevitVersion)  # "Py InternalUnit.ToDisplayUnit (Clockwork)"; IronPython2; same code as py_internalunit_todisplayunit
py_returnlistorsinglevalue_4 = Python(IN[0]=code_block_23, IN[1]=py_internalunit_todisplayunit_2)  # IronPython2; same code as py_returnlistorsinglevalue
code_block_30 = CodeBlock(materialVolumes=py_returnlistorsinglevalue_4) { materialVolumes; }

code_block_31 = CodeBlock(materialAreas=code_block_27) { materialAreas; }

# group: Match materials
string_4 = StringInput(".\Python_snippets\Map_names.py")
file_from_path_2 = FileObject(path=string_4)
readText = FileSystem.ReadText(file=file_from_path_2)
code_block_32 = CodeBlock(materials=name_2) { materials; }
watch_3 = Watch(code_block_32)
py_match_material_names = PythonStringNode(script=readText, IN[0]=watch_3)  # CPython3
watch_4 = Watch(py_match_material_names)

code_block_33 = CodeBlock(materialVolumes=code_block_30) { materialVolumes; }

# group: Split RC into steel and concrete (using constant ratio)
code_block_34 = CodeBlock(materials=watch_4, volumes=code_block_33) { materials; volumes; steel_concrete_ratio = 0.025; }
python_script_3 = Python(IN[0]=code_block_34.materials, IN[1]=code_block_34.volumes, IN[2]=code_block_34.steel_concrete_ratio)  # CPython3
# ---------- python_script_3.python (26 lines) ----------
# Load the Python Standard and DesignScript Libraries
import sys
import clr
clr.AddReference('ProtoGeometry')
from Autodesk.DesignScript.Geometry import *
from copy import deepcopy

materials = IN[0]
volumes = IN[1]
steel_concrete_ratio = IN[2]

new_materials = deepcopy(materials)
new_volumes = deepcopy(volumes)

for i in range(len(materials)):
    for j in range(len(materials[i])):
        if materials[i][j] == "Concrete":
            new_volumes[i][j] = volumes[i][j] * (1-steel_concrete_ratio)
            if "Steel" in materials[i]:
                steel_id = materials[i].index("Steel")
                new_volumes[i][steel_id] = volumes[i][j]*steel_concrete_ratio
            else:
                new_materials[i].append("Steel")
                new_volumes[i].append(volumes[i][j]*steel_concrete_ratio)

OUT = [new_materials, new_volumes, volumes[i][j]]
# ----------------------------------------
code_block_35 = CodeBlock(seq=python_script_3) { materials = seq[0]; volumes = seq[1]; }

watch_5 = Watch(code_block_35.materials)
watch_6 = Watch(code_block_35.volumes)

# group: Color in view by volume
code_block_36 = CodeBlock(elem=flatten) { elem; }
code_block_37 = CodeBlock { "Volume"; }
getParameterValueByName_5 = Element.GetParameterValueByName(element=code_block_36, parameterName=code_block_37)
code_block_38 = CodeBlock { 0.00; 1.00; }
remapRange = Math.RemapRange(numbers=getParameterValueByName_5, newMin=code_block_38.out0, newMax=code_block_38.out1)
code_block_39 = CodeBlock(x=remapRange) { 150*x+50; 150*(1-x)+50; }
byARGB = Color.ByARGB(red=code_block_39.out0, green=code_block_39.out1)
code_block_40 = CodeBlock(r=code_block_39.out0, g=code_block_39.out1) { r-50; g-50; }
byARGB_2 = Color.ByARGB(red=code_block_40.out0, green=code_block_40.out1)
fill_patterns = FillPatterns("<Solid fill>")
byProperties = Revit.Filter.OverrideGraphicSettings.ByProperties(projectionFillColor=byARGB, projectionLineColor=byARGB_2, projectionFillPattern=fill_patterns)
overrideInView = Element.OverrideInView(element=code_block_36, overrides=byProperties)
