# Dynamo graph 2_MeasureCircularity.dyn (Dynamo 2.10.1.3976)

# group: READ ME
# note: TBC...

# group: Check geometrical volume
code_block = CodeBlock { elem; }  # frozen; unwired: elem
code_block_2 = CodeBlock { "Volume"; }
getParameterValueByName = Element.GetParameterValueByName(element=code_block, parameterName=code_block_2)
sum = Math.Sum(values=getParameterValueByName)
sum_2 = Math.Sum(values=sum)
watch = Watch(sum_2)
geometry = Element.Geometry(element=code_block)  # frozen
flatten = List.Flatten(list=geometry)
volume = Solid.Volume(solid=flatten)
sum_3 = Math.Sum(values=volume)
code_block_3 = CodeBlock(x=sum_3) { x/1000000000; }
watch_2 = Watch(code_block_3)

# group: Get elements from groups
categories = Categories("OST_IOSModelGroups")  # frozen
all_elements_of_category = ElementsOfCategory(Category=categories)
getMembers = Group.GetMembers(group=all_elements_of_category)
flatten_2 = List.Flatten(list=getMembers)
uniqueItems = List.UniqueItems(list=flatten_2)

# group: Collect all elements
code_block_4 = CodeBlock()
# ---------- code_block_4.designscript (12 lines) ----------
[
"Doors",
"Windows",
"Floors",
"Structural Columns",
"Structural Framing",
"Walls",
"Ceilings",
"Columns",
"Roofs",
"Structural Foundations"
];
# ----------------------------------------
include_the_foundations = BoolSelector(true)  # graph input
code_block_5 = CodeBlock { 9; -1; }
if_ = If(test=include_the_foundations, true=code_block_5.out1, false=code_block_5.out0)
removeItemAtIndex = List.RemoveItemAtIndex(list=code_block_4, indices=if_)
byName = Category.ByName(name=removeItemAtIndex)
all_elements_of_category_2 = ElementsOfCategory(Category=byName)
flatten_3 = List.Flatten(list=all_elements_of_category_2)

# group: Take internal unit of measure ID
unit_types = UnitTypes("Area")
py_revit_version = Python()  # IronPython2
# ---------- py_revit_version.python (12 lines) ----------
import clr
clr.AddReference("RevitServices")
import RevitServices
from RevitServices.Persistence import DocumentManager

doc = DocumentManager.Instance.CurrentDBDocument
uiapp = DocumentManager.Instance.CurrentUIApplication
app = uiapp.Application
if int(app.VersionNumber) > 2017: fullVersion = app.SubVersionNumber
else: fullVersion = str(app.VersionNumber)

OUT = app.VersionName, int(app.VersionNumber), app.VersionBuild, app.Language.ToString(), fullVersion
# ----------------------------------------
code_block_6 = CodeBlock(seq=py_revit_version) { version = seq[1]; }
python_script = Python(IN[0]=unit_types, IN[1]=code_block_6)  # IronPython2
# ---------- python_script.python (43 lines) ----------
import clr
clr.AddReference('RevitAPI')
from Autodesk.Revit.DB import *

clr.AddReference("RevitServices")
import RevitServices
from RevitServices.Persistence import DocumentManager
doc = DocumentManager.Instance.CurrentDBDocument

dynunittype = IN[0]
if IN[1] > 2021:
	if str(dynunittype.GetType()) == "Autodesk.Revit.DB.ForgeTypeId":
		unittype = dynunittype
	elif str(dynunittype) == 'DynamoUnits.Area':
		unittype = ForgeTypeId('autodesk.spec.aec:area-2.0.0')
	elif str(dynunittype) == 'DynamoUnits.Length':
		unittype = ForgeTypeId('autodesk.spec.aec:length-2.0.0')
	elif str(dynunittype) == 'DynamoUnits.Volume':
		unittype = ForgeTypeId('autodesk.spec.aec:volume-2.0.0')
	else:
		unittype = None
	formatoptions = doc.GetUnits().GetFormatOptions(unittype)
	dispunits = formatoptions.GetUnitTypeId()
	symtype = formatoptions.GetSymbolTypeId()
	if symtype.TypeId == '': dispsym = None
	else: dispsym = LabelUtils.GetLabelForSymbol(symtype)
else:
	if str(dynunittype.GetType()) == "Autodesk.Revit.DB.UnitType":
		unittype = dynunittype
	elif str(dynunittype) == 'DynamoUnits.Area':
		unittype = UnitType.UT_Area
	elif str(dynunittype) == 'DynamoUnits.Length':
		unittype = UnitType.UT_Length
	elif str(dynunittype) == 'DynamoUnits.Volume':
		unittype = UnitType.UT_Volume
	else:
		unittype = None
	formatoptions = doc.GetUnits().GetFormatOptions(unittype)
	dispunits = formatoptions.DisplayUnits
	symtype = formatoptions.UnitSymbol
	if symtype == UnitSymbolType.UST_NONE: dispsym = None
	else: dispsym = LabelUtils.GetLabelFor(symtype)
OUT = (dispunits,dispsym)
# ----------------------------------------
code_block_7 = CodeBlock(seq=python_script) { displayUnitType = seq[0]; unitSymbol = seq[1]; }
unit_types_2 = UnitTypes("Volume")
python_script_2 = Python(IN[0]=unit_types_2, IN[1]=code_block_6)  # IronPython2; same code as python_script
code_block_8 = CodeBlock(seq=python_script_2) { displayUnitType = seq[0]; unitSymbol = seq[1]; }

# group: Collect info about materials (layers)
code_block_9 = CodeBlock(elem=flatten_3) { elem; }
turn_into_list = CodeBlock(x=code_block_9) { List.Flatten([x]); }
returnPaintMaterials = BoolSelector(false)
py_material_clockwork = Python(IN[0]=turn_into_list, IN[1]=returnPaintMaterials)  # IronPython2
# ---------- py_material_clockwork.python (22 lines) ----------
import clr
clr.AddReference('RevitAPI')
from Autodesk.Revit.DB import *

items = UnwrapElement(IN[0])
paintedmats = IN[1]
elementmats = list()
elementareas = list()
elementvols = list()

for item in items:
	matlist = list()
	arealist = list()
	vollist = list()
	for matid in item.GetMaterialIds(paintedmats):
		matlist.append(item.Document.GetElement(matid))
		arealist.append(item.GetMaterialArea(matid,paintedmats))
		vollist.append(item.GetMaterialVolume(matid))
	elementmats.append(matlist)
	elementareas.append(arealist)
	elementvols.append(vollist)
OUT = (elementmats,elementareas,elementvols)
# ----------------------------------------
code_block_10 = CodeBlock(seq=py_material_clockwork) { seq[0]; seq[1]; seq[2]; }
code_block_11 = CodeBlock(value=code_block_10.out1, displayUnitType=code_block_7.displayUnitType, RevitVersion=code_block_6) { value; displayUnitType; RevitVersion; }
py_internalunit_todisplayunit = Python(IN[0]=code_block_11.value, IN[1]=code_block_11.displayUnitType, IN[2]=code_block_11.RevitVersion)  # "Py InternalUnit.ToDisplayUnit (Clockwork)"; IronPython2
# ---------- py_internalunit_todisplayunit.python (26 lines) ----------
import clr
clr.AddReference('RevitAPI')
from Autodesk.Revit.DB import *

def FromInternalUnits(val, unittype):
	if (version > 2021 and str(dispunit.GetType()) == "Autodesk.Revit.DB.ForgeTypeId") or (version < 2022 and str(dispunit.GetType()) == "Autodesk.Revit.DB.DisplayUnitType"):
		return UnitUtils.ConvertFromInternalUnits(val,unittype)
	else: return None

vals = IN[0]
dispunit = IN[1]
version = IN[2]

# turn into list of lists:
if not isinstance(vals[0], list):
    vals = [vals]
if not isinstance(vals[0], list):
    vals = [vals]

OUT = []

for list in vals:
	inner = []
	for x in list:
		inner.append(FromInternalUnits(x, dispunit))
	OUT.append(inner)
# ----------------------------------------
py_returnlistorsinglevalue = Python(IN[0]=code_block_9, IN[1]=py_internalunit_todisplayunit)  # IronPython2
# ---------- py_returnlistorsinglevalue.python (4 lines) ----------
check = IN[0]
items = IN[1]
if isinstance(check, (list)): OUT = items
else: OUT = items[0]
# ----------------------------------------
code_block_12 = CodeBlock(materialAreas=py_returnlistorsinglevalue) { materialAreas; }  # frozen
isEmpty = List.IsEmpty()  # unwired: list
map = List.Map(list=code_block_10.out0, function=isEmpty)
not_ = Not(x=map)
py_returnlistorsinglevalue_2 = Python(IN[0]=code_block_9, IN[1]=not_)  # IronPython2; same code as py_returnlistorsinglevalue
code_block_13 = CodeBlock(hasMaterial=py_returnlistorsinglevalue_2) { hasMaterial; }
py_returnlistorsinglevalue_3 = Python(IN[0]=code_block_9, IN[1]=code_block_10.out0)  # IronPython2; same code as py_returnlistorsinglevalue
code_block_14 = CodeBlock(materials=py_returnlistorsinglevalue_3) { materials; }
name = Material.Name(material=code_block_14)
code_block_15 = CodeBlock(value=code_block_10.out2, displayUnitType=code_block_8.displayUnitType, RevitVersion=code_block_6) { value; displayUnitType; RevitVersion; }
py_internalunit_todisplayunit_2 = Python(IN[0]=code_block_15.value, IN[1]=code_block_15.displayUnitType, IN[2]=code_block_15.RevitVersion)  # "Py InternalUnit.ToDisplayUnit (Clockwork)"; IronPython2; same code as py_internalunit_todisplayunit
py_returnlistorsinglevalue_4 = Python(IN[0]=code_block_9, IN[1]=py_internalunit_todisplayunit_2)  # IronPython2; same code as py_returnlistorsinglevalue
code_block_16 = CodeBlock(materialVolumes=py_returnlistorsinglevalue_4) { materialVolumes; }

# group: Product utility
code_block_17 = CodeBlock { ProductLifespan = 50; ProductLifespan_average = 50; IntensityOfUse = 1; IntensityOfUse_average = 1; }
code_block_18 = CodeBlock(L_j=code_block_17.ProductLifespan, L_av_j=code_block_17.ProductLifespan_average, U_j=code_block_17.IntensityOfUse, U_av_j=code_block_17.IntensityOfUse_average)
# ---------- code_block_18.designscript (2 lines) ----------
//Product Utility
X = (L_j/L_av_j)*(U_j/U_av_j);
# ----------------------------------------

# group: Load input data
string = StringInput(".\data\Material_data.json")
file_from_path = FileObject(path=string)
readText = FileSystem.ReadText(file=file_from_path)
parseJSON = Data.ParseJSON(json=readText)
watch_3 = Watch(parseJSON)

# group: Load code
string_2 = StringInput(".\snippets\Add_steel_to_RC.py")
file_from_path_2 = FileObject(path=string_2)
readText_2 = FileSystem.ReadText(file=file_from_path_2)

# group: Load mapping data and code
string_3 = StringInput(".\snippets\Map_names.py")
file_from_path_3 = FileObject(path=string_3)
readText_3 = FileSystem.ReadText(file=file_from_path_3)
string_4 = StringInput(".\data\Material_mapping.json")
file_from_path_4 = FileObject(path=string_4)
readText_4 = FileSystem.ReadText(file=file_from_path_4)

# group: Match materials
code_block_19 = CodeBlock(materials=name) { materials; }
watch_4 = Watch(code_block_19)
py_match_material_names = PythonStringNode(script=readText_3, IN[0]=readText_4, IN[1]=watch_4)  # CPython3
watch_5 = Watch(py_match_material_names)

# group: Split RC into steel and concrete (using constant ratio)
code_block_20 = CodeBlock(original_materials=watch_4, materials=watch_5, volumes=code_block_16) { original_materials; materials; volumes; steel_concrete_ratio = 0.025; }
py_add_steel_to_rc = PythonStringNode(script=readText_2, IN[0]=code_block_20.original_materials, IN[1]=code_block_20.materials, IN[2]=code_block_20.volumes, IN[3]=code_block_20.steel_concrete_ratio)  # IronPython2
code_block_21 = CodeBlock(OUT=py_add_steel_to_rc) { materials = OUT[0]; volumes = OUT[1]; original_materials = OUT[2]; }

# group: Filter by volume
code_block_22 = CodeBlock(original_material=code_block_21.original_materials, material_name=code_block_21.materials, material_volume=code_block_21.volumes) { original_material; material_name; material_volume; }
sum_4 = Math.Sum(values=code_block_22.material_volume)
code_block_23 = CodeBlock { 0; 0.0001; }
eq = Equals(x=sum_4, y=code_block_23.out0, tolerance=code_block_23.out1)
filterByBoolMask = List.FilterByBoolMask(list=code_block_22.material_name, mask=eq)
filterByBoolMask_2 = List.FilterByBoolMask(list=code_block_22.material_volume, mask=eq)
code_block_24 = CodeBlock { 0; 0.0001; }
eq_2 = Equals(x=filterByBoolMask_2.out, y=code_block_24.out0, tolerance=code_block_24.out1)
filterByBoolMask_3 = List.FilterByBoolMask(list=filterByBoolMask.out, mask=eq_2)
flatten_4 = List.Flatten(list=filterByBoolMask_3.out)
code_block_25 = CodeBlock(elements=flatten_3) { elements; }
filterByBoolMask_4 = List.FilterByBoolMask(list=code_block_25, mask=eq)
code_block_26 = CodeBlock(elements=filterByBoolMask_4.out) { elements; }
filterByBoolMask_5 = List.FilterByBoolMask(list=filterByBoolMask_2.out, mask=eq_2)
count = List.Count(list=filterByBoolMask_5.out, lacing=Longest)
flatten_5 = List.Flatten(list=filterByBoolMask_5.out)
filterByBoolMask_6 = List.FilterByBoolMask(list=code_block_22.original_material, mask=eq)
filterByBoolMask_7 = List.FilterByBoolMask(list=filterByBoolMask_6.out, mask=eq_2)
flatten_6 = List.Flatten(list=filterByBoolMask_7.out)

# group: Extract data for each material
code_block_27 = CodeBlock(data=watch_3, material=flatten_4)
# ---------- code_block_27.designscript (18 lines) ----------
Dictionary.ValueAtKey(Dictionary.ValueAtKey(data, material), "C_R");
Dictionary.ValueAtKey(Dictionary.ValueAtKey(data, material), "C_U");
Dictionary.ValueAtKey(Dictionary.ValueAtKey(data, material), "C_C");

Dictionary.ValueAtKey(Dictionary.ValueAtKey(data, material), "E_R");
Dictionary.ValueAtKey(Dictionary.ValueAtKey(data, material), "HHV");
Dictionary.ValueAtKey(Dictionary.ValueAtKey(data, material), "M_B");

Dictionary.ValueAtKey(Dictionary.ValueAtKey(data, material), "B_C");

Dictionary.ValueAtKey(Dictionary.ValueAtKey(data, material), "E_F");
Dictionary.ValueAtKey(Dictionary.ValueAtKey(data, material), "E_C");

Dictionary.ValueAtKey(Dictionary.ValueAtKey(data, material), "Density");

Dictionary.ValueAtKey(Dictionary.ValueAtKey(data, material), "F_R");
Dictionary.ValueAtKey(Dictionary.ValueAtKey(data, material), "F_U");
Dictionary.ValueAtKey(Dictionary.ValueAtKey(data, material), "F_S");
# ----------------------------------------
code_block_28 = CodeBlock(F_S=code_block_27.out12, F_R=code_block_27.out10, F_U=code_block_27.out11, C_R=code_block_27.out0, C_U=code_block_27.out1)
# ---------- code_block_28.designscript (7 lines) ----------
[
F_S,
F_R,
F_U,
C_R,
C_U
];
# ----------------------------------------
code_block_29 = CodeBlock(volume=flatten_5) { volume; }
code_block_30 = CodeBlock(volume=code_block_29, density=code_block_27.out9)
# ---------- code_block_30.designscript (2 lines) ----------
//Mass
M=volume*density;
# ----------------------------------------

# group: Replace empty values with defaults from JSON
transpose = List.Transpose(lists=code_block_28)
code_block_31 = CodeBlock()
# ---------- code_block_31.designscript (7 lines) ----------
[
"Biological material",
"Recycled material",
"Reused material",
"EoL recycling",
"Eol reuse"
];
# ----------------------------------------
getParameterValueByName_2 = Element.GetParameterValueByName(element=code_block_26, parameterName=code_block_31, lacing=CrossProduct)
ofRepeatedItem = List.OfRepeatedItem(item=getParameterValueByName_2, amount=count, lacing=Longest)
code_block_32 = CodeBlock { 1; }
flatten_7 = List.Flatten(list=ofRepeatedItem, amt=code_block_32)
python_script_3 = Python(IN[0]=transpose, IN[1]=flatten_7)  # IronPython2
# ---------- python_script_3.python (10 lines) ----------
OUT = []

for i in range(len(IN[1])):
	sub = []
	for j in range(len(IN[1][i])):
		if IN[1][i][j] == "":
			sub.append(IN[0][i][j])
		else:
			sub.append(IN[1][i][j]/100)
	OUT.append(sub)
# ----------------------------------------
transpose_2 = List.Transpose(lists=python_script_3)
code_block_33 = CodeBlock(OUT=transpose_2) { F_S = OUT[0]; F_R = OUT[1]; F_U = OUT[2]; C_R = OUT[3]; C_U = OUT[4]; }
code_block_34 = CodeBlock { "Biological material"; }
getParameterValueByName_3 = Element.GetParameterValueByName(element=code_block_26, parameterName=code_block_34, lacing=Longest)

# group: Load mapping data and code
string_5 = StringInput(".\snippets\Disassembly_indicator.py")
file_from_path_5 = FileObject(path=string_5)
readText_5 = FileSystem.ReadText(file=file_from_path_5)
string_6 = StringInput(".\data\Disassembly_data.json")
file_from_path_6 = FileObject(path=string_6)
readText_6 = FileSystem.ReadText(file=file_from_path_6)

# group: Calculate Disassembly Index
code_block_35 = CodeBlock(elements=code_block_26) { elements; }
code_block_36 = CodeBlock()
# ---------- code_block_36.designscript (4 lines) ----------
["Connection type",
"Connection accessibility",
"Crossings",
"Form containment"];
# ----------------------------------------
getParameterValueByName_4 = Element.GetParameterValueByName(element=code_block_35, parameterName=code_block_36, lacing=CrossProduct)
python_script_from_string = PythonStringNode(script=readText_5, IN[0]=getParameterValueByName_4, IN[1]=readText_6)  # IronPython2
sum_5 = Math.Sum(values=python_script_from_string, lacing=Longest)
code_block_37 = CodeBlock(DI=sum_5)
# ---------- code_block_37.designscript (3 lines) ----------
//Disassembly index
DI;
//(the higher the better, max 4.0, min 0.4)
# ----------------------------------------

# group: Divide into categories and building layers
code_block_38 = CodeBlock(elements=code_block_26) { elements; }
code_block_39 = CodeBlock { "Building layer"; }
getParameterValueByName_5 = Element.GetParameterValueByName(element=code_block_38, parameterName=code_block_39, lacing=Longest)
string_from_object = FromObject(object=getParameterValueByName_5)
getCategory = Element.GetCategory(element=code_block_38)
string_from_object_2 = FromObject(object=getCategory)
code_block_40 = CodeBlock(IN=string_from_object, cat=string_from_object_2)
# ---------- code_block_40.designscript (7 lines) ----------
x1 = String.Replace(IN, "1", "Stru ");
x2 = String.Replace(x1, "2", "Skin ");
x3 = String.Replace(x2, "4", "Plan ");

cat1 = String.Replace(cat, "Structural ", "");

name = x3 + cat1;
# ----------------------------------------
code_block_41 = CodeBlock(elements=code_block_38, categories=code_block_40.name, building_layers=string_from_object) { elements; categories; building_layers; }

# group: Material Circularity Indicator calculations
code_block_42 = CodeBlock(F_S=code_block_33.F_S, F_R=code_block_33.F_R, F_U=code_block_33.F_U, C_R=code_block_33.C_R, C_U=code_block_33.C_U, C_C=code_block_27.out2, E_R=code_block_27.out3, HHV=code_block_27.out4, M_B=code_block_27.out5, B_C=code_block_27.out6, E_F=code_block_27.out7, E_C=code_block_27.out8, mass=code_block_30, org_mat=flatten_6) { F_S; F_R; F_U; C_R; C_U; C_C; E_R; HHV; M_B; B_C; E_F; E_C; mass; org_mat; }
code_block_43 = CodeBlock(M=code_block_42.mass, F_R=code_block_42.F_R, F_U=code_block_42.F_U, F_S=code_block_42.F_S)
# ---------- code_block_43.designscript (2 lines) ----------
//Amount of virgin material
V = M*(1-F_R-F_U-F_S);
# ----------------------------------------
code_block_44 = CodeBlock(E_R=code_block_42.E_R, HHV=code_block_42.HHV, M_B=code_block_42.M_B)
# ---------- code_block_44.designscript (6 lines) ----------
//efficiency of the
//energy recovery process
//E_E = E_R/(HHV*M_B);
E_R;
HHV;
M_B;
# ----------------------------------------
py_e_e = Python(IN[0]=code_block_44.E_R, IN[1]=code_block_44.HHV, IN[2]=code_block_44.M_B)  # IronPython2
# ---------- py_e_e.python (11 lines) ----------
E_R = IN[0]
HHV = IN[1]
M_B = IN[2]

OUT = []

for i in range(len(IN[0])):
	try:
		OUT.append(E_R[i]/(HHV[i]*M_B[i]))
	except ZeroDivisionError:
		OUT.append(0)
# ----------------------------------------
code_block_45 = CodeBlock(E_E=py_e_e, B_C=code_block_42.B_C)
# ---------- code_block_45.designscript (4 lines) ----------
//Fraction of mass of a product being collected
//for energy recovery where the material
//satisfies the requirements for inclusion
C_E = E_E*B_C;
# ----------------------------------------
code_block_46 = CodeBlock(M=code_block_42.mass, C_R=code_block_42.C_R, C_U=code_block_42.C_U, C_C=code_block_42.C_C, C_E=code_block_45)
# ---------- code_block_46.designscript (2 lines) ----------
//Waste from the linear flow Wj
W_0 = M*(1-C_R-C_U-C_C-C_E);
# ----------------------------------------
code_block_47 = CodeBlock(M=code_block_42.mass, F_R=code_block_42.F_R, E_F=code_block_42.E_F)
# ---------- code_block_47.designscript (7 lines) ----------
//Waste to produce any recycled
//content used as feedstock in
//the  recycling process
//W_F = M*F_R*(1-E_F)/E_F;
M;
F_R;
E_F;
# ----------------------------------------
py_w_f = Python(IN[0]=code_block_47.M, IN[1]=code_block_47.F_R, IN[2]=code_block_47.E_F)  # IronPython2
# ---------- py_w_f.python (11 lines) ----------
M = IN[0]
F_R = IN[1]
E_F = IN[2]

OUT = []

for i in range(len(IN[0])):
	try:
		OUT.append(M[i]*F_R[i]*(1-E_F[i])/E_F[i])
	except ZeroDivisionError:
		OUT.append(0)
# ----------------------------------------
code_block_48 = CodeBlock(M=code_block_42.mass, E_C=code_block_42.E_C, C_R=code_block_42.C_R)
# ---------- code_block_48.designscript (2 lines) ----------
//Waste generated in the  recycling process Wj
W_C = M*(1-E_C)*C_R;
# ----------------------------------------
code_block_49 = CodeBlock(W_0=code_block_46, W_F=py_w_f, W_C=code_block_48)
# ---------- code_block_49.designscript (2 lines) ----------
//Amount of unrecoverable waste
W = W_0+(W_F+W_C)/2;
# ----------------------------------------
code_block_50 = CodeBlock(V=code_block_43, W=code_block_49, M=code_block_42.mass)
# ---------- code_block_50.designscript (2 lines) ----------
//Linear Flow Index
LFI = (V+W)/(2*M);
# ----------------------------------------
code_block_51 = CodeBlock(X=code_block_18, LFI=code_block_50)
# ---------- code_block_51.designscript (2 lines) ----------
//Material Circularity Indicator
MCI = 1-(0.9/X*LFI);
# ----------------------------------------
code_block_52 = CodeBlock { 0; }
ge = code_block_51 >= code_block_52
if_2 = If(test=ge, true=code_block_51, false=code_block_52)
code_block_53 = CodeBlock(MCI=if_2) { MCI; }
code_block_54 = CodeBlock(elements=code_block_26, count=count, categories=code_block_41.categories) { elements; count; categories; }
ofRepeatedItem_2 = List.OfRepeatedItem(item=code_block_54.elements, amount=code_block_54.count, lacing=Longest)
flatten_8 = List.Flatten(list=ofRepeatedItem_2)
id = Element.Id(element=flatten_8)
ofRepeatedItem_3 = List.OfRepeatedItem(item=code_block_54.categories, amount=code_block_54.count, lacing=Longest)
flatten_9 = List.Flatten(list=ofRepeatedItem_3)
code_block_55 = CodeBlock { "Type"; }
getParameterValueByName_6 = Element.GetParameterValueByName(element=flatten_8, parameterName=code_block_55)
code_block_56 = CodeBlock { "Type Name"; }
getParameterValueByName_7 = Element.GetParameterValueByName(element=getParameterValueByName_6, parameterName=code_block_56)
div = code_block_43 / code_block_42.mass
div_2 = code_block_46 / code_block_42.mass
code_block_57 = CodeBlock(product_id=id, product_category=flatten_9, product_name=getParameterValueByName_7, original_material=code_block_42.org_mat, material_name=flatten_4, material_volume=code_block_29, material_density=code_block_27.out9, material_weight=code_block_42.mass, V=div, F_R=code_block_47.F_R, F_U=code_block_42.F_U, F_S=code_block_42.F_S, C_R=code_block_42.C_R, C_U=code_block_42.C_U, W_0=div_2, Linear_flow_index=code_block_50, MCI=code_block_53)
# ---------- code_block_57.designscript (19 lines) ----------
[
product_id,
product_category,
product_name,
original_material,
material_name,
material_volume,
material_density,
material_weight,
V,
F_R,
F_U,
F_S,
C_R,
C_U,
W_0,
Linear_flow_index,
MCI
];
# ----------------------------------------

# group: Product Circularity Indicator calculations
code_block_58 = CodeBlock(MCI=code_block_53) { MCI; }
code_block_59 = CodeBlock(count=count) { count; }
chop = List.Chop(list=code_block_58, lengths=code_block_59)
code_block_60 = CodeBlock(M=code_block_42.mass)
# ---------- code_block_60.designscript (2 lines) ----------
//Mass
M;
# ----------------------------------------
chop_2 = List.Chop(list=code_block_60, lengths=code_block_59)
mul = chop * chop_2
sum_6 = Math.Sum(values=mul)
sum_7 = Math.Sum(values=chop_2)
div_3 = sum_6 / sum_7
code_block_61 = CodeBlock(temp=div_3, DI=code_block_37)
# ---------- code_block_61.designscript (2 lines) ----------
//Product Circularity Indicator
PCI = temp*DI/4;
# ----------------------------------------
code_block_62 = CodeBlock(Mj=sum_7) { Mj; }
code_block_63 = CodeBlock(elements=code_block_35, categories=code_block_41.categories) { elements; categories; }
id_2 = Element.Id(element=code_block_63.elements)
code_block_64 = CodeBlock { "Type"; }
getParameterValueByName_8 = Element.GetParameterValueByName(element=code_block_63.elements, parameterName=code_block_64)
code_block_65 = CodeBlock { "Type Name"; }
getParameterValueByName_9 = Element.GetParameterValueByName(element=getParameterValueByName_8, parameterName=code_block_65)
code_block_66 = CodeBlock(product_id=id_2, product_category=code_block_63.categories, product_name=getParameterValueByName_9, product_volume=sum_7, Disassembly_ind=code_block_37, PCI=code_block_61)
# ---------- code_block_66.designscript (8 lines) ----------
[
product_id,
product_category,
product_name,
product_volume,
Disassembly_ind,
PCI
];
# ----------------------------------------
code_block_67 = CodeBlock(DI=code_block_37)
# ---------- code_block_67.designscript (2 lines) ----------
//Disassembly index
DI;
# ----------------------------------------

# group: System Circularity Indicator calculations
code_block_68 = CodeBlock(PCI=code_block_61, Mj=code_block_62) { temp = PCI*Mj; }
code_block_69 = CodeBlock(elements=code_block_41.elements, category=code_block_41.categories) { elements; category; }
groupByKey = List.GroupByKey(list=code_block_68, keys=code_block_69.category)
sum_8 = Math.Sum(values=groupByKey.groups)
code_block_70 = CodeBlock(Mj=code_block_62) { Mj; }
groupByKey_2 = List.GroupByKey(list=code_block_70, keys=code_block_69.category)
sum_9 = Math.Sum(values=groupByKey_2.groups)
code_block_71 = CodeBlock(temp=sum_8, Ms=sum_9)
# ---------- code_block_71.designscript (3 lines) ----------
//System Circularity Indicator
// SCI = PCI*Mj/Ms;
SCI = temp/Ms;
# ----------------------------------------
groupByKey_3 = List.GroupByKey(list=code_block_69.elements, keys=code_block_69.category)
watch_6 = Watch(groupByKey_3.unique_keys)

# group: Building Circularity Indicator calculations
code_block_72 = CodeBlock(elements=code_block_69.elements, category=code_block_69.category, bl=code_block_41.building_layers) { elements; category; bl; }
code_block_73 = CodeBlock(IN=code_block_72.bl) { x1 = String.Replace(IN, "4", "0.9"); x2 = String.Replace(x1, "2", "0.7"); x3 = String.Replace(x2, "1", "0.2"); }
groupByKey_4 = List.GroupByKey(list=code_block_73.x3, keys=code_block_72.category)
toNumber = String.ToNumber(str=groupByKey_4.groups)
average = Math.Average(numbers=toNumber)
watch_7 = Watch(average)
code_block_74 = CodeBlock(SCI=code_block_71, BL=watch_7)
# ---------- code_block_74.designscript (5 lines) ----------
//Building Circularity Indicator
//LK = 0.1+0.2+0.7+0.8+0.9+1.0;
//We take only Structure+Skin+SpacePlan
LK = 0.2+0.7+0.9;
BCI = Math.Sum(SCI*BL)/LK;
# ----------------------------------------

code_block_75 = CodeBlock(MCI=code_block_53, PCI=code_block_61, SCI=code_block_71, BCI=code_block_74.BCI) { MCI; PCI; SCI; BCI; }

# group: Save results to parameter
code_block_76 = CodeBlock { "Material Circularity Indicator"; }
code_block_77 = CodeBlock(MCI=code_block_75.MCI, PCI=code_block_75.PCI, SCI=code_block_75.SCI, BCI=code_block_75.BCI) { MCI; PCI; SCI; BCI; }
setParameterByName = Element.SetParameterByName(parameterName=code_block_76, value=code_block_77.MCI)  # frozen; unwired: element
code_block_78 = CodeBlock(elements=code_block_26) { elements; }
code_block_79 = CodeBlock { "Product Circularity Indicator"; }
setParameterByName_2 = Element.SetParameterByName(element=code_block_78, parameterName=code_block_79, value=code_block_77.PCI)
code_block_80 = CodeBlock { "System Circularity Indicator"; }
setParameterByName_3 = Element.SetParameterByName(parameterName=code_block_80, value=code_block_77.SCI)  # frozen; unwired: element
categories_2 = Categories("OST_ProjectInformation")
all_elements_of_category_3 = ElementsOfCategory(Category=categories_2)
code_block_81 = CodeBlock(i=all_elements_of_category_3) { i[0]; }
code_block_82 = CodeBlock { "Building Circularity Indicator"; }
setParameterByName_4 = Element.SetParameterByName(element=code_block_81, parameterName=code_block_82, value=code_block_77.BCI)

string_7 = StringInput(".\data\Lifespan_expectancy.json")
file_from_path_7 = FileObject(path=string_7)
readText_7 = FileSystem.ReadText(file=file_from_path_7)

# group: Display circularity results in UI
code_block_83 = CodeBlock(PCI=code_block_75.PCI, SCI=code_block_75.SCI, BCI=code_block_75.BCI, categories=watch_6) { PCI; SCI; BCI; categories; }
average_2 = Math.Average(numbers=code_block_83.PCI)
code_block_84 = CodeBlock(x=average_2) { "Your average Product Circularity Indicator is: "+x+"."; }
product_circularity_indicator = Watch(code_block_84)  # "Product Circularity Indicator score"; graph output
code_block_85 = CodeBlock(BCI=code_block_83.BCI) { "Your Building Circularity Indicator is: "+BCI+"."; }
building_circularity_indicator = Watch(code_block_85)  # "Building Circularity Indicator score"; graph output
code_block_86 = CodeBlock { "System Circularity Indicator is:"; }
code_block_87 = CodeBlock(SCI=code_block_83.SCI, cat=code_block_83.categories) { " "+Math.Round(SCI, 2)+" for "+cat; }
code_block_88 = CodeBlock { 4; 4; }
remove = String.Remove(string=code_block_87, startIndex=code_block_88.out0, count=code_block_88.out1)
join = List.Join(list0=code_block_86, list1=remove)
string_from_array = FromArray(array=join)
code_block_89 = CodeBlock { 0; 1; }
remove_2 = String.Remove(string=string_from_array, startIndex=code_block_89.out0, count=code_block_89.out1)
code_block_90 = CodeBlock { -1; 1; }
remove_3 = String.Remove(string=remove_2, startIndex=code_block_90.out0, count=code_block_90.out1)
code_block_91 = CodeBlock { 32; 1; }
remove_4 = String.Remove(string=remove_3, startIndex=code_block_91.out0, count=code_block_91.out1)
system_circularity_indicator = Watch(remove_4)  # "System Circularity Indicator score"; graph output

# group: TODO
code_block_92 = CodeBlock()  # // Compute volumes for non volumetric elements (now foundations fail!)

average_3 = Math.Average(numbers=code_block_71)
code_block_93 = CodeBlock(BCI=code_block_74.BCI, SCI=average_3)
# ---------- code_block_93.designscript (4 lines) ----------
[
BCI,
SCI
];
# ----------------------------------------
categories_3 = Categories("OST_ProjectInformation")
all_elements_of_category_4 = ElementsOfCategory(Category=categories_3)
code_block_94 = CodeBlock(i=all_elements_of_category_4) { i[0]; }
code_block_95 = CodeBlock()
# ---------- code_block_95.designscript (5 lines) ----------
[
"Project Name",
"Project Address",
"Author"
];
# ----------------------------------------
getParameterValueByName_10 = Element.GetParameterValueByName(element=code_block_94, parameterName=code_block_95)

# group: Generate Excel report
excel_template_file_location = StringInput(".\template\Template_Excel_report.xlsx")
file_from_path_8 = FileObject(path=excel_template_file_location)
excel_report_directory_path = Directory("C:\Users\arturbt\Desktop\Temp")  # graph input
string_8 = StringInput("\")
excel_report_file_name = StringInput("MyCircularityReport")  # graph input
string_9 = StringInput(".xlsx")
concat = String.Concat(string0=excel_report_directory_path, string1=string_8, string2=excel_report_file_name, string3=string_9)
boolean = BoolSelector(true)
copyFile = FileSystem.CopyFile(file=file_from_path_8, destinationPath=concat, overwrite=boolean)
if_3 = If(test=copyFile, true=concat, false=concat)
code_block_96 = CodeBlock()
# ---------- code_block_96.designscript (4 lines) ----------
["MCI_results",
"PCI_results",
"Report",
"Report"];
# ----------------------------------------
code_block_97 = CodeBlock { [1,1,14,0]; [0,0,4,1]; }
code_block_98 = CodeBlock(MCI_data=code_block_57, PCI_data=code_block_66, Report_data=code_block_93, Project_name=getParameterValueByName_10) { MCI_data; PCI_data; Report_data; Project_name; }
transpose_3 = List.Transpose(lists=code_block_98.MCI_data)
transpose_4 = List.Transpose(lists=code_block_98.PCI_data)
transpose_5 = List.Transpose(lists=code_block_98.Report_data)
transpose_6 = List.Transpose(lists=code_block_98.Project_name)
list_create = List.Create(item0=transpose_3, item1=transpose_4, item2=transpose_5, item3=transpose_6)
code_block_99 = CodeBlock(data=list_create) { data; }
boolean_2 = BoolSelector(false)
exportExcel = Data.ExportExcel(filePath=if_3, sheetName=code_block_96, startRow=code_block_97.out0, startCol=code_block_97.out1, data=code_block_99, overWrite=boolean_2)

# group: Info display
isEmpty_2 = List.IsEmpty(list=exportExcel)
code_block_100 = CodeBlock(path=if_3) { "You're data was succesfully exported to Excel: "+path; "There was a problem exporting your Excel data."; }
if_4 = If(test=isEmpty_2, true=code_block_100.out1, false=code_block_100.out0)
export_result = Watch(if_4)  # graph output
