# Dynamo graph 3_VisualizeResults.dyn (Dynamo 2.10.1.3976)

# group: READ ME
# note: TBC...

# group: Get elements from groups
categories = Categories("OST_IOSModelGroups")  # frozen
all_elements_of_category = ElementsOfCategory(Category=categories)
getMembers = Group.GetMembers(group=all_elements_of_category)
flatten = List.Flatten(list=getMembers)
uniqueItems = List.UniqueItems(list=flatten)

# group: Collect all elements
code_block = CodeBlock()
# ---------- code_block.designscript (12 lines) ----------
[
"Doors",
"Windows",
"Floors",
"Structural Columns",
"Structural Framing",
"Walls",
"Ceilings",
"Columns",
"Roofs",
"Structural Foundations"
];
# ----------------------------------------
include_the_foundations = BoolSelector(true)  # graph input
code_block_2 = CodeBlock { 9; -1; }
if_ = If(test=include_the_foundations, true=code_block_2.out0, false=code_block_2.out1)
removeItemAtIndex = List.RemoveItemAtIndex(list=code_block, indices=if_)
byName = Category.ByName(name=removeItemAtIndex)
all_elements_of_category_2 = ElementsOfCategory(Category=byName)
flatten_2 = List.Flatten(list=all_elements_of_category_2)

# group: Take all other elements from the view
id = Element.Id(element=flatten_2)
all_elements_in_active_view = ElementsInView()
id_2 = Element.Id(element=all_elements_in_active_view)
python_script = Python(IN[0]=id, IN[1]=id_2)  # IronPython2
# ---------- python_script.python (13 lines) ----------
# Load the Python Standard and DesignScript Libraries
import sys
import clr
clr.AddReference('ProtoGeometry')
from Autodesk.DesignScript.Geometry import *

list_A = IN[0]
list_B = IN[1]

common = set(list_B).intersection(list_A)
difference = set(list_B) - set(list_A)

OUT = [common, difference]
# ----------------------------------------
code_block_3 = CodeBlock(seq=python_script) { common = seq[0]; difference = seq[1]; }
watch = Watch(code_block_3.common)
element_by_id = ElementById(Id=watch)
watch_2 = Watch(code_block_3.difference)
element_by_id_2 = ElementById(Id=watch_2)

code_block_4 = CodeBlock(elem=element_by_id) { elem; }
code_block_5 = CodeBlock { ""; }
code_block_6 = CodeBlock()
# ---------- code_block_6.designscript (2 lines) ----------
"Product Circularity Indicator";
//"System Circularity Indicator";
# ----------------------------------------
getParameterValueByName = Element.GetParameterValueByName(element=code_block_4, parameterName=code_block_6)
eq = code_block_5 == getParameterValueByName
filterByBoolMask = List.FilterByBoolMask(list=code_block_4, mask=eq)
filterByBoolMask_2 = List.FilterByBoolMask(list=getParameterValueByName, mask=eq)

# group: Color in view by indicator
code_block_7 = CodeBlock()
# ---------- code_block_7.designscript (8 lines) ----------
[
Color.ByARGB(255, 255, 237, 0),
Color.ByARGB(255, 0, 189, 124)
];
[
1.00,
0.00
];
# ----------------------------------------
code_block_8 = CodeBlock { 0.00; 1.00; }
remapRange = Math.RemapRange(numbers=filterByBoolMask_2.out, newMin=code_block_8.out0, newMax=code_block_8.out1)
color_range = ColorRange(colors=code_block_7.out0, indices=code_block_7.out1, value=remapRange)
code_block_9 = CodeBlock()
# ---------- code_block_9.designscript (8 lines) ----------
[
Color.ByARGB(255, 205, 187, 0),
Color.ByARGB(255, 0, 139, 94)
];
[
1.00,
0.00
];
# ----------------------------------------
color_range_2 = ColorRange(colors=code_block_9.out0, indices=code_block_9.out1, value=remapRange)
code_block_10 = CodeBlock { "<Solid fill>"; }
getByName = FillPatternElement.GetByName(name=code_block_10)
byProperties = Revit.Filter.OverrideGraphicSettings.ByProperties(projectionFillColor=color_range, projectionLineColor=color_range_2, projectionFillPattern=getByName)
overrideInView = Element.OverrideInView(element=filterByBoolMask.out, overrides=byProperties)
code_block_11 = CodeBlock()  # frozen
# ---------- code_block_11.designscript (14 lines) ----------
[
Color.ByARGB(255, 0, 189, 124),
Color.ByARGB(255, 255, 237, 0),
Color.ByARGB(255, 102, 204, 204),
Color.ByARGB(255, 68, 68, 68),
Color.ByARGB(255, 236, 26, 146)
];
[
0.00,
0.25,
0.50,
0.75,
1.00
];
# ----------------------------------------

# group: Color those that have no indicator
code_block_12 = CodeBlock(elements=filterByBoolMask.in) { elements; }
code_block_13 = CodeBlock { Color.ByARGB(255, 68, 68, 68); }
fill_patterns = FillPatterns("<Solid fill>")
byProperties_2 = Revit.Filter.OverrideGraphicSettings.ByProperties(projectionFillColor=code_block_13, projectionLineColor=code_block_13, projectionFillPattern=fill_patterns)
overrideInView_2 = Element.OverrideInView(element=code_block_12, overrides=byProperties_2)

# group: Color all unwanted elements gray and transparent.
code_block_14 = CodeBlock(elements=element_by_id_2) { elements; }
code_block_15 = CodeBlock { 100; }
byARGB = Color.ByARGB(r=code_block_15, g=code_block_15, b=code_block_15)
code_block_16 = CodeBlock { 150; }
byARGB_2 = Color.ByARGB(r=code_block_16, g=code_block_16, b=code_block_16)
fill_patterns_2 = FillPatterns("<Solid fill>")
code_block_17 = CodeBlock { 80; }
byProperties_3 = Revit.Filter.OverrideGraphicSettings.ByProperties(projectionFillColor=byARGB, projectionLineColor=byARGB_2, projectionFillPattern=fill_patterns_2, transparency=code_block_17)
overrideInView_3 = Element.OverrideInView(element=code_block_14, overrides=byProperties_3)
